# Grasshopper definition Json Generation.gh (Grasshopper 1.0.7)
# plug-ins: BH.UI.Grasshopper

getinfo = GetInfo(Component="{ .GetInfo")
# <Script name>
project_number = Panel("")
setprojectid = SetProjectID(ProjectID=project_number, Component="{ .SetProjectID")
bhom_version_used_to_create = Panel("8.2")
bhom_version_currently_installed = Panel(getinfo)
bhomtypelist = BHoMTypeList(Component="{ .BHoMTypeList")
createtype = CreateType(Component="BH.oM.Geometry.IGeometry")
c_script = CSharpScript(x=bhomtypelist, y=createtype)  # -> out, A; inputs x: list
# ---------- c_script: C# usings ----------
using System.Linq;
# ---------- c_script: C# ----------
    A = x.Where(t => (y as Type).IsAssignableFrom(t as Type));
# ---------- end c_script ----------
tsort = SortText(Keys=c_script.A, Culture=127)  # -> Keys, Values
panel = Panel(tsort.Keys)
number_slider = Slider(3, range=0..10)
polygon = Polygon(Plane=PlaneXY(0, 0, 0), Radius=3, Segments=Slider(4, range=0..10), FilletRadius=0)  # -> Polygon, Length
point = Point(X=0, Y=0, Z=Slider(10, range=0..10), Component="{ .Point")
series = Series(Start=0, Step=1, Count=Slider(5, range=0..10))
bhomgeo = BHoMGeometry(
    polygon.Polygon,
    ObjectType="{ \"_t\" : \"System.Type\", \"Name\" : \"System.Object, mscorlib, Version=4.0.0.0, Culture=neutral, PublicKeyToken=b77a5c561934e089\", \"_bhomVersion\" : \"8.2\" }",
    m_ForcePreview=False,
    m_MaxItemsPreview=10000)
move = Move(Motion=Vector(0, 0, 10))  # -> Geometry, Transform
multiplication = Multiplication(A=number_slider, B=2)
crv = Curve([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])
point_2 = Point(X=0, Y=0, Z=Slider(10, range=0..10), Component="{ .Point")
brep = Brep(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)
number_slider_2 = Slider(10, range=0..10)
line = Line(
    Start="{ \"_t\" : \"BH.oM.Geometry.Point\", \"X\" : 0.0, \"Y\" : 0.0, \"Z\" : 0.0, \"_bhomVersion\" : \"8.2\" }",
    End=point,
    Infinite=False,
    Component="BH.oM.Geometry.Line")
crv_2 = Curve([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])
crv_3 = Curve([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])
X = UnitX(Factor=series)
explode = Explode(Object=bhomgeo, Component="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")
rectangle = Rectangle(Plane=PlaneXY(0, 0, 0), XSize=multiplication, YSize=multiplication, Radius=0)  # -> Rectangle, Length
crv_4 = Curve(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)
isubparts = ISubParts(Geometry=crv, Component="{ .ISubParts")  # -> flatten(I)
line_2 = Line(
    Start="{ \"_t\" : \"BH.oM.Geometry.Point\", \"X\" : 0.0, \"Y\" : 0.0, \"Z\" : 0.0, \"_bhomVersion\" : \"8.2\" }",
    End=point_2,
    Infinite=False,
    Component="BH.oM.Geometry.Line")
mplane = MeshPlane(Boundary=rectangle.Rectangle, WidthCount=number_slider, HeightCount=number_slider)  # -> Mesh, Area
rad = Radians(Degrees=Slider(180, range=0..1000))
point_3 = Point(X=0, Y=0, Z=0, Component="{ .Point")
point_4 = Point(X=0, Y=0, Z=Slider(10, range=0..10), Component="{ .Point")
move_2 = Move(Geometry=line, Motion=X)  # -> Geometry, Transform
planarsurface = PlanarSurface(BoundaryCurves=crv_3, Tolerance=1e-06, Component="{ .PlanarSurface")
point_5 = Point(X=number_slider_2, Y=number_slider_2, Z=Slider(5, range=0..10), Component="{ .Point")
X_2 = UnitX(Factor=1)
Y = UnitY(Factor=1)
srf = Surface(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)
crv_5 = Curve(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)
point_6 = Point(X=0, Y=0, Z=0, Component="BH.oM.Geometry.Point")
X_3 = UnitX(Factor=1)
Y_2 = UnitY(Factor=1)
torus = Torus(
    Centre="{ \"_t\" : \"BH.oM.Geometry.Point\", \"X\" : 0.0, \"Y\" : 0.0, \"Z\" : 0.0, \"_bhomVersion\" : \"8.2\" }",
    Axis="{ \"_t\" : \"BH.oM.Geometry.Vector\", \"X\" : 0.0, \"Y\" : 0.0, \"Z\" : 1.0, \"_bhomVersion\" : \"8.2\" }",
    RadiusMajor=Slider(5, range=0..10),
    RadiusMinor=Slider(1, range=0..1),
    Component="BH.oM.Geometry.Torus")
cuboid = Cuboid(
    CoordinateSystem="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",
    Length=Slider(2, range=0..10),
    Depth=Slider(3, range=0..10),
    Height=Slider(5, range=0..10),
    Component="BH.oM.Geometry.Cuboid")
ijoin = IJoin(Curves=isubparts, Tolerance=1e-06, Component="{ .IJoin")
sphere = Sphere(
    Centre="{ \"_t\" : \"BH.oM.Geometry.Point\", \"X\" : 0.0, \"Y\" : 0.0, \"Z\" : 0.0, \"_bhomVersion\" : \"8.2\" }",
    Radius=Slider(5, range=0..10),
    Component="BH.oM.Geometry.Sphere")
plane = Plane(
    Origin="{ \"_t\" : \"BH.oM.Geometry.Point\", \"X\" : 0.0, \"Y\" : 0.0, \"Z\" : 0.0, \"_bhomVersion\" : \"8.2\" }",
    Normal="{ \"_t\" : \"BH.oM.Geometry.Vector\", \"X\" : 0.0, \"Y\" : 0.0, \"Z\" : 1.0, \"_bhomVersion\" : \"8.2\" }",
    Component="BH.oM.Geometry.Plane")
vector = Vector(X=0, Y=0, Z=Slider(10, range=0..10), Component="BH.oM.Geometry.Vector")
bhomgeo_2 = BHoMGeometry(
    move.Transform,
    ObjectType="{ \"_t\" : \"System.Type\", \"Name\" : \"System.Object, mscorlib, Version=4.0.0.0, Culture=neutral, PublicKeyToken=b77a5c561934e089\", \"_bhomVersion\" : \"8.2\" }",
    m_ForcePreview=False,
    m_MaxItemsPreview=10000)
quaternion = Quaternion(X=0, Y=0, Z=0, W=0, Component="BH.oM.Geometry.Quaternion")
loft = Loft(Curves=move_2.Geometry, Component="BH.oM.Geometry.Loft")
ellipse = Ellipse(Centre=point_3, Radius1=Slider(3, range=0..10), Radius2=Slider(5, range=0..10), Component="{ .Ellipse")
bhomgeo_3 = BHoMGeometry(
    crv_4,
    ObjectType="{ \"_t\" : \"System.Type\", \"Name\" : \"System.Object, mscorlib, Version=4.0.0.0, Culture=neutral, PublicKeyToken=b77a5c561934e089\", \"_bhomVersion\" : \"8.2\" }",
    m_ForcePreview=False,
    m_MaxItemsPreview=10000)
pipe = Pipe(Centreline=line_2, Radius=Slider(2, range=0..10), Capped=True, Component="BH.oM.Geometry.Pipe")
line_3 = Line(
    Start="{ \"_t\" : \"BH.oM.Geometry.Point\", \"X\" : 0.0, \"Y\" : 0.0, \"Z\" : 0.0, \"_bhomVersion\" : \"8.2\" }",
    End=point_4,
    Infinite=False,
    Component="BH.oM.Geometry.Line")
point_7 = Point(X="1", Y="2", Z="3", Component="BH.oM.Geometry.Point")
polygon_2 = Polygon(Vertices=explode, Tolerance=1e-06, Component="{ .Polygon")
arc = Arc(
    CoordinateSystem="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",
    Radius=Slider(5, range=0..10),
    StartAngle=0,
    EndAngle=rad,
    Component="BH.oM.Geometry.Arc")
cylinder = Cylinder(
    Centre="{ \"_t\" : \"BH.oM.Geometry.Point\", \"X\" : 0.0, \"Y\" : 0.0, \"Z\" : 0.0, \"_bhomVersion\" : \"8.2\" }",
    Axis="{ \"_t\" : \"BH.oM.Geometry.Vector\", \"X\" : 0.0, \"Y\" : 0.0, \"Z\" : 1.0, \"_bhomVersion\" : \"8.2\" }",
    Radius=Slider(3, range=0..10),
    Height=Slider(8, range=0..10),
    Component="BH.oM.Geometry.Cylinder")
bhomgeo_4 = BHoMGeometry(
    mplane.Mesh,
    ObjectType="{ \"_t\" : \"System.Type\", \"Name\" : \"System.Object, mscorlib, Version=4.0.0.0, Culture=neutral, PublicKeyToken=b77a5c561934e089\", \"_bhomVersion\" : \"8.2\" }",
    m_ForcePreview=False,
    m_MaxItemsPreview=10000)
circle = Circle(
    Centre="{ \"_t\" : \"BH.oM.Geometry.Point\", \"X\" : 0.0, \"Y\" : 0.0, \"Z\" : 0.0, \"_bhomVersion\" : \"8.2\" }",
    Normal="{ \"_t\" : \"BH.oM.Geometry.Vector\", \"X\" : 0.0, \"Y\" : 0.0, \"Z\" : 1.0, \"_bhomVersion\" : \"8.2\" }",
    Radius=Slider(5, range=0..10),
    Component="BH.oM.Geometry.Circle")
extrusion = Extrusion(
    Curve=circle,
    Direction="{ \"_t\" : \"BH.oM.Geometry.Vector\", \"X\" : 0.0, \"Y\" : 0.0, \"Z\" : 1.0, \"_bhomVersion\" : \"8.2\" }",
    Capped=True,
    Component="BH.oM.Geometry.Extrusion")
boundarycurve = BoundaryCurve(Curves=crv_2, Tolerance=1e-06, Component="{ .BoundaryCurve")
face = Face(A=0, B=Slider(1, range=0..1), C=Slider(2, range=0..10), D=Slider(3, range=0..10), Component="BH.oM.Geometry.Face")
bhomgeo_5 = BHoMGeometry(
    brep,
    ObjectType="{ \"_t\" : \"System.Type\", \"Name\" : \"System.Object, mscorlib, Version=4.0.0.0, Culture=neutral, PublicKeyToken=b77a5c561934e089\", \"_bhomVersion\" : \"8.2\" }",
    m_ForcePreview=False,
    m_MaxItemsPreview=10000)
bhomgeo_6 = BHoMGeometry(
    crv_5,
    ObjectType="{ \"_t\" : \"System.Type\", \"Name\" : \"System.Object, mscorlib, Version=4.0.0.0, Culture=neutral, PublicKeyToken=b77a5c561934e089\", \"_bhomVersion\" : \"8.2\" }",
    m_ForcePreview=False,
    m_MaxItemsPreview=10000)
cartesiancoordinatesystem = CartesianCoordinateSystem(Origin=point_6, X=X_3, Y=Y_2, Component="{ .CartesianCoordinateSystem")
boundingbox = BoundingBox(
    Min="{ \"_t\" : \"BH.oM.Geometry.Point\", \"X\" : 0.0, \"Y\" : 0.0, \"Z\" : 0.0, \"_bhomVersion\" : \"8.2\" }",
    Max=point_5,
    Component="BH.oM.Geometry.BoundingBox")
basis = Basis(X=X_2, Y=Y, Component="{ .Basis")
cone = Cone(
    Centre="{ \"_t\" : \"BH.oM.Geometry.Point\", \"X\" : 0.0, \"Y\" : 0.0, \"Z\" : 0.0, \"_bhomVersion\" : \"8.2\" }",
    Axis="{ \"_t\" : \"BH.oM.Geometry.Vector\", \"X\" : 0.0, \"Y\" : 0.0, \"Z\" : 1.0, \"_bhomVersion\" : \"8.2\" }",
    Radius=Slider(3, range=0..10),
    Height=Slider(8, range=0..10),
    Component="BH.oM.Geometry.Cone")
bhomgeo_7 = BHoMGeometry(
    srf,
    ObjectType="{ \"_t\" : \"System.Type\", \"Name\" : \"System.Object, mscorlib, Version=4.0.0.0, Culture=neutral, PublicKeyToken=b77a5c561934e089\", \"_bhomVersion\" : \"8.2\" }",
    m_ForcePreview=False,
    m_MaxItemsPreview=10000)
merge = Merge(
    Data1=arc,
    Data2=basis,
    Data3=boundarycurve,
    Data4=bhomgeo_5,
    Data5=boundingbox,
    Data6=circle,
    Data7=cone,
    Data8=cartesiancoordinatesystem,
    Data9=cuboid,
    Data10=cylinder,
    Data11=ellipse,
    Data12=extrusion,
    Data13=face,
    Data14=line_3,
    Data15=loft,
    Data16=bhomgeo_4,
    Data17=bhomgeo_6,
    Data18=bhomgeo_7,
    Data19=pipe,
    Data20=planarsurface,
    Data21=plane,
    Data22=point_7,
    Data23=ijoin,
    Data24=polygon_2,
    Data25=bhomgeo_3,
    Data26=quaternion,
    Data27=sphere,
    Data28=torus,
    Data29=bhomgeo_2,
    Data30=vector)  # -> flatten(Result)
bhomgeo_8 = BHoMGeometry(
    graft(merge),
    ObjectType="{ \"_t\" : \"System.Type\", \"Name\" : \"System.Object, mscorlib, Version=4.0.0.0, Culture=neutral, PublicKeyToken=b77a5c561934e089\", \"_bhomVersion\" : \"8.2\" }",
    m_ForcePreview=False,
    m_MaxItemsPreview=10000)
c_script_2 = CSharpScript()  # -> out, A
# ---------- c_script_2: C# ----------
    A = GrasshopperDocument.FilePath;
# ---------- end c_script_2 ----------
pushconfig = PushConfig(
    UseDatasetSerialization=False,
    SkipUnsupportedTypes=False,
    BeautifyJson=Toggle(False),
    DisableWarnings=False,
    WrapNonBHoMObjects=False,
    AllowHashForComparing=False,
    DiffingConfig="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",
    Component="BH.oM.Adapters.File.PushConfig")
c_script_3 = CSharpScript(x=c_script_2.A, y=bhomgeo_8)  # -> out, A; inputs x: String
# ---------- c_script_3: C# ----------
    string[] split = x.Split('\\');
    string basePath = string.Join("\\", split.Take(split.Length - 2)) + "\\SchemaDocumentationGenerator\\JsonExamples";
    A = basePath + "\\" + y.GetType().Assembly.GetName().Name + "\\" + y.GetType().Name + ".json";
# ---------- end c_script_3 ----------
pushtype = PushType(
    {"FullPush": 0, "CreateOnly": 1, "CreateNonExisting": 2, "UpdateOnly": 3, "UpdateOrCreateOnly": 4, "DeleteThenCreate": 5, "AdapterDefault": 6}, selected="DeleteThenCreate",
    Component="BH.oM.Adapter.PushType",
    Selection=5)
fileadapter = FileAdapter(TargetLocation=c_script_3.A, Component="{ ..ctor")
toggle = BooleanToggle(True)
push = Push(Adapter=fileadapter, Objects=bhomgeo_8, PushType=pushtype, ActionConfig=pushconfig, Active=Button(), Component="{ .Push")  # -> Objects, Success
panel_2 = Panel(c_script_3.A)
